vi "Main Window.gvi"   [LabVIEW NXG 5.0.0]
panel controls:
  "Acquire Button": bool
  "Load Measurement": bool
  "Save Measurement": bool
  "Main Tab": i32
  "Custom date": bool
  "Author Initials": string
  "Batch Name": string
  "Cell Number": string
  "Sample Comments": string
  "Abort Button": bool
  "Exit App Button": bool
  "Add Layer Button": bool
  "Add Layer Button_2": bool
  "Add Layer Button_3": bool
  "Label Info Error Label": string
  "Label Info Missing Error": bool
  "Config Tab": i32
  "Misc Data Mega Cluster": "Misc Mega Cluster.gtype"
  "Instrument Control Mega Cluster": "Instrument Control Mega Cluster.gtype"
  "Desired Cell": "Cell Selector.gtype" = "L.01"
  "Set Cell": bool
  "Cell Parameters": "Cell Parameters.gtype" = {"Max (V)"=1, "Min (V)"=-0.2, "Sweep Dir"=FALSE, "Curr Range (A)"=0.1, "Autorange"=TRUE, "Max (A)"=1, "Cell Area (m^2)"=8e-06, "Light Power (W m^-2)"=1000}
  "JV Scan Mode": "JV Scan Mode.gtype" = "Rough"
  "Measurement Precision": "Accuracy Parameters.gtype"
  "Default Data Saving Location": path
  "Cell Selector": "Cell Selector.gtype"
  "JV Measurements Mega Cluster": "JV Measurements Mega Cluster.gtype"
panel indicators:
  "Current Date": string
  "Progress %": f64
  "State": string
  "Substate": string
  "Sample Prefix": string
  "Progress counter": f64
  "Layer Information": string[]
  "Live JV Parameters": "Live IV Parameters.gtype"
  "JV Main Graph": f64[]
  "Current State": "Queue Instructions Control.gtype"
  "Elapsed Time (kr)": f64
  "Estimated Time (kr)": f64
types:
  "Live IV Parameters.gtype" = cluster{"Current (A)": f64, "Voltage (V)": f64, "Cur Density (A/m^2)": f64, "Current Cell": enum{""}}
  T1 = cluster{"State Ref": "StringControl reference", "Substate Ref": "StringControl reference", "Current State Ref": "EnumSelector reference", "Main Tab Ref": "TabControl reference"}
  T2 = cluster{"Default Data Saving Location Ref": "PathSelector reference"}
  T3 = cluster{"Author Initials Ref": "ComboBoxSelector reference", "Batch Name Ref": "StringControl reference", "Cell Number Ref": "StringControl reference", "Current Date Ref": "StringControl reference", "Sample Comments Ref": "StringControl reference", "Sample Prefix Ref": "StringControl reference", "Custom Date Ref": "CheckBox reference", "Label Info Error Label Ref": "StringControl reference", "Label Info Missing Error Ref": "BooleanControl reference"}
  T4 = cluster{"Cell Parameters Ref": "Cluster reference", "Cell Selector Ref": "Cluster reference", "Measurement Precision Ref": "Cluster reference", "JV Scan Mode Ref": "EnumSelector reference"}
  T5 = cluster{"Live JV Parameters Ref": "Cluster reference", "Progress % Ref": "ProgressBar reference", "Progress Counter Ref": "NumericTextBoxDouble reference"}
  T6 = cluster{"Layer Information Ref": "ArrayViewer reference"[]}
  "Full Reference Cluster.gtype" = cluster{"Status Report": T1, "Path Cluster": T2, "Sample Naming Cluster": T3, "Acquisition Parameters": T4, "Live Progress Cluster": T5, "Sample Extra Information": T6}
  "Misc Mega Cluster.gtype" = cluster{"Full Reference Cluster": "Full Reference Cluster.gtype"}
  "Queue Instructions Control.gtype" = enum{"Undefined State", "Debug Check", "Initialize App", "Idle", "Change Cell", "IV Curves Acquisition", "Saving TXT Files", "Generating Origin Files", "Stopping App", "State 1", "State2", "State3", "State4", "State5"}
  T7 = cluster{"Element 1": "VISA Instr", "Element 2": string}
  T8 = enum{"Keithley 2400 Series", "Keithley 2450 Series"}
  "Instrument Control.gtype" = cluster{"Multiplexer Arduino Detected?": bool, "Multiplexer Arduino Address": "VISA Instr", "Arduinos List": T7[], "Multiplexer Log": string, "Keythley Address": "VISA Instr", "Keithley Detected?": bool, "Keithley ID": string, "Detected Keithley Type": T8}
  "Debugging Cluster.gtype" = cluster{"Debugging mode?": bool, "Initialize App": bool, "Insturment Debugging": cluster{"Keithley": bool, "Arduino": bool}}
  "Instrument Control Mega Cluster.gtype" = cluster{"Instrument Control": "Instrument Control.gtype", "Debugging Cluster": "Debugging Cluster.gtype"}
  "Cell Selector.gtype" = enum{"L.01", "L.02", "L.03", "L.04", "L.05", "L.06", "L.07", "L.08", "L.09", "L.10", "L.11", "L.12", "R.01", "R.02", "R.03", "R.04", "R.05", "R.06", "R.07", "R.08", "R.09", "R.10", "R.11", "R.12", "Custom"}
  "Cell Parameters.gtype" = cluster{"Max (V)": f64, "Min (V)": f64, "Sweep Dir": bool, "Curr Range (A)": f64, "Autorange": bool, "Max (A)": f64, "Cell Area (m^2)": f64, "Light Power (W m^-2)": f64}
  "JV Scan Mode.gtype" = enum{"Rough", "Normal", "Accurate", "Smart", "Custom"}
  "Accuracy Parameters.gtype" = cluster{"V Points": u32, "Current Avg": u32, "Integration Time": f64, "Iterations": u32, "Rs Rsh Slope points": u32}
  "JV Data Cluster.gtype" = cluster{"Voltage (V)": f64[], "Current (A)": f64[], "Current Density (A/m^2)": f64[], "Cell Area (m^2)": f64, "Illumination (W/m^2)": f64, "Voc (V)": f64, "Jsc (A/m^2)": f64, "FF (%)": f64, "Rsh (Ω · m^2)": f64, "Rs (Ω · m^2)": f64, "Eff (%)": f64, "Measured Cell": "Cell Selector.gtype", "No Multiplexer": bool}
  "JV Curve Parameters.gtype" = cluster{"Cell Parameters": "Cell Parameters.gtype", "Measurement Precision": "Accuracy Parameters.gtype", "JV Scan Mode": "JV Scan Mode.gtype"}
  "JV Measurements Mega Cluster.gtype" = cluster{"Cell Array": "Cell Selector.gtype"[], "JV Full Data Array": "JV Data Cluster.gtype"[], "JV Curve Parameters": "JV Curve Parameters.gtype", "Cell Selector": "Cell Selector.gtype"}
uses:
  Pika IV Characterization NXG::Main Functions::Initializing App::Reference Setting::Acquisition Parameters.gvi
  Pika IV Characterization NXG::Main Functions::Initializing App::Reference Setting::Live Progress Cluster.gvi
  Pika IV Characterization NXG::Main Functions::Initializing App::Reference Setting::Path Cluster.gvi
  Pika IV Characterization NXG::Main Functions::Initializing App::Reference Setting::Sample Extra Information.gvi
  Pika IV Characterization NXG::Main Functions::Initializing App::Reference Setting::Sample Naming Cluster.gvi
  Pika IV Characterization NXG::Main Functions::Initializing App::Reference Setting::Status Report.gvi
  Pika IV Characterization NXG::Side Functions::Abort Control::FGV Global Abort.gvi
  Pika IV Characterization NXG::Main Functions::Instruction Handling::FGV Current State.gvi
  Pika IV Characterization NXG::Side Functions::Timeout::FGV Progress.gvi
  Pika IV Characterization NXG::Side Functions::Timeout::Time Out Subroutine.gvi
  Pika IV Characterization NXG::Side Functions::Exit App Sequence.gvi
  Pika IV Characterization NXG::Side Functions::Utilities::Cell Naming::Sample Naming Subroutine.gvi
  Pika IV Characterization NXG::Side Functions::Utilities::Cell Naming::FGV Sample Prefix.gvi
  Pika IV Characterization NXG::Main Functions::Instruction Handling::Check Queue And Label.gvi
  Pika IV Characterization NXG::Main Functions::Instruction Handling::Condition Enqueue.gvi
  Pika IV Characterization NXG::Main Functions::JV Curve Full Subroutine::JV Operation Translation.gvi
  Pika IV Characterization NXG::Side Functions::Instrument Control::Arduino Multiplexer::Set Cell Requisites.gvi
  NI::G Core::Error::Is Error.gvi
  Pika IV Characterization NXG::Side Functions::Abort Control::Abort Sequence.gvi
  Pika IV Characterization NXG::Side Functions::Debugging::Debugging Prompt.gvi
  Pika IV Characterization NXG::Main Functions::Initializing App::Initialize App Subroutine.gvi
  Pika IV Characterization NXG::Side Functions::Instrument Control::Arduino Multiplexer::Set Cell Subroutine.gvi
  Pika IV Characterization NXG::Main Functions::JV Curve Full Subroutine::Full JV Curve Measurement Subroutine.gvi
  NI::G Core::Error::Multiplex Errors.gvi
  NI::G Core::Error::Display Error.gvi
diagram:
  case (TRUE) {
    frame False, Default {
      w1 = default
    }
    frame True {
      Property Node(instance in=$"Misc Data Mega Cluster") -> ("Full Reference Cluster"=w2, instance out=w3)
      call "Acquisition Parameters.gvi"(Cell Parameters Ref=reference to "Cell Parameters", JV Scan Mode Ref=reference to "JV Scan Mode", Measurement Precision Ref=reference to "Measurement Precision", Cell Selector Ref=reference to "Cell Selector", Full Reference Cluster In=w2) -> (Error Out=w4, Full Reference Cluster Out=w5)
      call "Live Progress Cluster.gvi"(Progress % Ref=reference to "Progress %", Progress Counter Ref=reference to "Progress counter", Live JV Parameters=reference to "Live JV Parameters", Error In=w4, Full Reference Cluster In=w5) -> (Error Out=w6, Full Reference Cluster Out=w7)
      call "Path Cluster.gvi"(Default Data Saving Location Ref=reference to "Default Data Saving Location", Error In=w6, Full Reference Cluster=w7) -> (Error Out=w8, Full Reference Cluster Out=w9)
      call "Sample Extra Information.gvi"(Layer Information Ref=reference to "Layer Information", Error In=w8, Full Reference Cluster=w9) -> (Error Out=w10, Full Reference Cluster Out=w11)
      call "Sample Naming Cluster.gvi"(Author Initials Ref=reference to "Author Initials", Batch Name Ref=reference to "Batch Name", Cell Number Ref=reference to "Cell Number", Current Date Ref=reference to "Current Date", Sample Comments Ref=reference to "Sample Comments", Sample Prefix Ref=reference to "Sample Prefix", Custom Date Ref=reference to "Custom date", Label Info Error Label Ref=reference to "Label Info Error Label", Label Info Missing Error Ref=reference to "Label Info Missing Error", Error In=w10, Full Reference Cluster In=w11) -> (Error Out=w12, Full Reference Cluster Out=w13)
      call "Status Report.gvi"(State Ref=reference to "State", Substate Ref=reference to "Substate", Current State Ref=reference to "Current State", Main Tab Ref=reference to "Main Tab", Error In=w12, Full Reference Cluster In=w13) -> (Error Out=w1, Full Reference Cluster Out=w14)
      Property Node(instance in=w3, "Full Reference Cluster"=w14) -> (instance out=w15)
      $"Misc Data Mega Cluster" <- w15
    }
  }
  call "FGV Global Abort.gvi"(Global Abort Instructions="Reset State", Error In=w1) -> (Error Out=w16)
  call "FGV Current State.gvi"(Current State Instructions="Set Current State and Substate", Current State="Undefined State", Current Substate="Starting Up", Error In=w16) -> (Error Out=w17)
  Obtain Queue(create if not found=TRUE, element data type="Queue Instructions Control.gtype" "Undefined State", error in=w17, name="Instruction Queue") -> (error out=w18, queue out=w19)
  Enqueue Element(element="Debug Check", error in=w18, queue=w19) -> (error out=w20, queue out=w21)
  s1 = w21  # shift register
  while {
    event (timeout = 50) {
      on "Timeout" {
        call "FGV Progress.gvi"(FGV Instructions="Read State", Error In=w20) -> (Progress Out=w25, Elapsed Time Out (kr)=w26, Estimated Time Out (kr)=w27, Error Out=w28)
        $"Progress %" <- w25
        $"Progress counter" <- w25
        $"Estimated Time (kr)" <- w27
        call "Time Out Subroutine.gvi"(Queue In=s1, Misc Data Mega Cluster In=$"Misc Data Mega Cluster", Error In=w28) -> (Queue Out=w23, Misc Data Mega Cluster Out=w29, Stop App?=w24, Error Out=w22)
        $"Misc Data Mega Cluster" <- w29
        $"Elapsed Time (kr)" <- w26
      }
      on "Exit App Button" Value changed {
        call "Exit App Sequence.gvi"(Queue In=s1, Exit App=$"Exit App Button", Error In=w20) -> (Queue Out=w23, Error Out=w22)
        w24 = default
      }
      on "Author Initials" Value changed; "Batch Name" Value changed; "Cell Number" Value changed; "Current Date" Value changed; "Custom date" Value changed; "Sample Comments" Value changed; "Sample Prefix" Value changed {
        call "Sample Naming Subroutine.gvi"(Misc Data Mega Cluster In=$"Misc Data Mega Cluster", Error In=w20) -> (Misc Data Mega Cluster Out=w30, Error Out=w31)
        $"Misc Data Mega Cluster" <- w30
        call "FGV Sample Prefix.gvi"(FGV Instructions="Set State", Misc Mega Cluster In=w30, Error In=w31) -> (Error Out=w22)
        w23 = s1
        w24 = default
      }
      on "Acquire Button" Value changed; "Save Measurement" Value changed {
        call "Check Queue And Label.gvi"(Label Info Error Label=$"Label Info Error Label", Label Info Missing Error=$"Label Info Missing Error", Error In=w20, Is Label Necessary?=TRUE) -> (Proceed to enqueue=w32, Error Out=w33)
        call "Condition Enqueue.gvi"(Queue In=s1, Queue Instruction="IV Curves Acquisition", Error In=w33, Equeue?=w32) -> (Queue Out=w23, Error Out=w34)
        call "JV Operation Translation.gvi"(Acquire Button=$"Acquire Button", Load Measurement=FALSE, Save Measurement=$"Save Measurement", Error In=w34) -> (Error Out=w22)
        w24 = default
      }
      on "Load Measurement" Value changed {
        call "Check Queue And Label.gvi"(Label Info Error Label=$"Label Info Error Label", Label Info Missing Error=$"Label Info Missing Error", Error In=w20, Is Label Necessary?=TRUE) -> (Proceed to enqueue=w35, Error Out=w36)
        call "Condition Enqueue.gvi"(Queue In=s1, Queue Instruction="IV Curves Acquisition", Error In=w36, Equeue?=w35) -> (Queue Out=w23, Error Out=w37)
        call "JV Operation Translation.gvi"(Acquire Button=FALSE, Load Measurement=$"Load Measurement", Save Measurement=FALSE, Error In=w37) -> (Error Out=w22)
        w24 = default
      }
      on "Set Cell" Value changed {
        call "Set Cell Requisites.gvi"(Queue In=s1, Instrument Control Mega Cluster=$"Instrument Control Mega Cluster", Error In=w20, Set Cell=$"Set Cell") -> (Queue Out=w23, Error Out=w22)
        w24 = default
      }
    }
    call "Is Error.gvi"(error in=w22) -> (error?=w38)
    Logical Or(w38, w24) -> w39
    next s1 = w23
    stop if w39
  }
  Enqueue Element(element="Stopping App", error in=w22, queue=s1) -> (error out=w40, queue out=w41)
  s2 = w21  # shift register
  s3 = w20  # shift register
  while {
    event (timeout = 100) {
      on "Timeout" {
        call "FGV Global Abort.gvi"(Global Abort Instructions="Read Current State", Error In=s3) -> (Global Abort Out=w45, Error Out=w46)
        Preview Queue Element(error in=w46, queue=s2, timeout in ms=100) -> (element=w47, error out=w42, queue out=w43)
        Is Equal(x=w47, y="Stopping App") -> w48
        Logical Or(w48, w45) -> w44
      }
      on "Abort Button" Value changed {
        call "Abort Sequence.gvi"(Queue In=s2, Global Abort=$"Abort Button", Error In=s3) -> (Queue Out=w43, Error Out=w42)
        w44 = default
      }
    }
    next s2 = w43
    next s3 = w42
    stop if w44
  }
  Enqueue Element(element="Stopping App", error in=s3, queue=s2) -> (error out=w49)
  s4 = w21  # shift register
  while {
    Dequeue Element(error in=w20, queue=s4) -> (element=w50, error out=w51, queue out=w52)
    case (w50) {
      frame "Undefined State", Default {
        w53 = w51
        w54 = w52
        w55 = default
      }
      frame "Debug Check" {
        call "Debugging Prompt.gvi"(Instrument Control Mega Cluster In=$"Instrument Control Mega Cluster", Error In=w51) -> (Instrument Control Mega Cluster Out=w56, Error Out=w57)
        Enqueue Element(element="Initialize App", error in=w57, queue=w52) -> (error out=w53, queue out=w54)
        $"Instrument Control Mega Cluster" <- w56
        w55 = default
      }
      frame "Initialize App" {
        call "Initialize App Subroutine.gvi"(Instrument Control Mega Cluster In=$"Instrument Control Mega Cluster", Misc Data Mega Cluster In=$"Misc Data Mega Cluster", Error In=w51) -> (Instrument Control Mega Cluster Out=w58, Misc Data Mega Cluster Out=w59, Error Out=w60)
        $"Instrument Control Mega Cluster" <- w58
        $"Misc Data Mega Cluster" <- w59
        Enqueue Element(element="Idle", error in=w60, queue=w52) -> (error out=w53, queue out=w54)
        w55 = default
      }
      frame "Idle" {
        call "FGV Global Abort.gvi"(Global Abort Instructions="Reset Local", Error In=w51) -> (Error Out=w61)
        call "FGV Current State.gvi"(Current State Instructions="Set Current State and Substate", Current State="Idle", Current Substate="Idle", Error In=w61) -> (Error Out=w62)
        call "FGV Progress.gvi"(FGV Instructions="Reset State", Error In=w62) -> (Error Out=w53)
        w54 = w52
        w55 = default
      }
      frame "Change Cell" {
        call "Set Cell Subroutine.gvi"(Instrument Control Mega Cluster In=$"Instrument Control Mega Cluster", Error In=w51) -> (Instrument Control Mega Cluster Out=w63, Error Out=w64)
        Enqueue Element(element="Idle", error in=w64, queue=w52) -> (error out=w53, queue out=w54)
        $"Instrument Control Mega Cluster" <- w63
        w55 = default
      }
      frame "IV Curves Acquisition" {
        call "Full JV Curve Measurement Subroutine.gvi"(Instrument Control Mega Cluster In=$"Instrument Control Mega Cluster", Misc Data Mega Cluster In=$"Misc Data Mega Cluster", JV Measurements Mega Cluster In=$"JV Measurements Mega Cluster", Error In=w51) -> (Instrument Control Mega Cluster Out=w65, Misc Data Mega Cluster Out=w66, JV Measurements Mega Cluster Out=w67, Error Out=w68)
        $"Instrument Control Mega Cluster" <- w65
        $"Misc Data Mega Cluster" <- w66
        Enqueue Element(element="Idle", error in=w68, queue=w52) -> (error out=w53, queue out=w54)
        $"JV Measurements Mega Cluster" <- w67
        w55 = default
      }
      frame "Stopping App" {
        call "FGV Current State.gvi"(Current State Instructions="Set Current State and Substate", Current State="Stopping App", Current Substate="Bye Bye :D", Error In=w51) -> (Error Out=w53)
        w54 = w52
        w55 = TRUE
      }
    }
    call "Is Error.gvi"(error in=w53) -> (error?=w69)
    Logical Or(w69, w55) -> w70
    call "FGV Global Abort.gvi"(Global Abort Instructions="Reset State", Global Abort=w70, Error In=w53) -> (Error Out=w71)
    next s4 = w54
    stop if w70
  }
  Enqueue Element(element="Stopping App", error in=w71, queue=s4) -> (error out=w72)
  call "Multiplex Errors.gvi"(error in 1=w40, error in 2=w72, error in 3=w49) -> (error out=w73)
  Flush Queue(error in=w73, queue=w41) -> (error out=w74, queue out=w75)
  Release Queue(error in=w74, queue=w75) -> (error out=w76)
  case (w76) {
    frame Error, Default {
      # In case there is an error
      # put out an error handler
      call "Display Error.gvi"(error in=w76)
    }
    frame No Error { }
  }
